# Dynamo graph ExportExcelCategory.dyn.dyn "test" (Dynamo 3.3.0.6316)

file_path = Filename(".\finalproject.xlsx")
string = StringInput("StructuralBeam")
integer_slider = IntegerSlider(0, range=0..100 step 1)
integer_slider_2 = IntegerSlider(0, range=0..100 step 1)
categories = Categories("OST_StructuralFramingSystem")
all_elements_of_category = ElementsOfCategory(Category=categories)
parameters = Element.Parameters(element=all_elements_of_category)
exportToExcel = Data.ExportToExcel(filePath=file_path, sheetName=string, startRow=integer_slider, startColumn=integer_slider_2, data=parameters)
